# Grasshopper definition Workshop (1).gh (Grasshopper 0.9.76)
# plug-ins: Weaverbird, Tarsier, TT Toolbox

# ---- group: Wind / ReadExcel
read_excel_sheet = ReadExcelSheet(Run=Toggle(True), Worksheet="Sheet1", Listen=False)  # -> UserMessages, Columns, Rows

# ---- group: Temperature
read_excel_sheet_2 = ReadExcelSheet(Run=Toggle(True), Worksheet="Sheet2", Listen=False)  # -> UserMessages, Columns, Rows

# ---- group: Precipitation / ReadExcelData
read_excel_sheet_3 = ReadExcelSheet(Run=Toggle(True), Worksheet="Sheet3", Listen=False)  # -> UserMessages, Columns, Rows

# ---- group: Ice / ReadExcelData
read_excel_sheet_4 = ReadExcelSheet(Run=Toggle(True), Worksheet="Sheet4", Listen=False)  # -> UserMessages, Columns, Rows

# ---- group: Wind / WindLongitude
list_item = ListItem(List=read_excel_sheet.Rows, Index=Slider(1, range=0..100), Wrap=True)  # -> flatten(Item)
cull_index = CullIndex(List=list_item, Indices=Slider(0, range=0..100), Wrap=True)
radians = Radians(Degrees=cull_index)

# ---- group: Wind / WindLatitude
list_item_2 = ListItem(List=read_excel_sheet.Rows, Index=Slider(0, range=0..100), Wrap=True)  # -> flatten(Item)
cull_index_2 = CullIndex(List=list_item_2, Indices=Slider(0, range=0..100), Wrap=True)
radians_2 = Radians(Degrees=cull_index_2)

# ---- group: Temperature / TemperatureLongitude
list_item_3 = ListItem(List=read_excel_sheet_2.Rows, Index=Slider(1, range=0..100), Wrap=True)  # -> flatten(Item)
cull_index_3 = CullIndex(List=list_item_3, Indices=Slider(0, range=0..100), Wrap=True)
radians_3 = Radians(Degrees=cull_index_3)

# ---- group: Temperature / TemperatureLatitude
list_item_4 = ListItem(List=read_excel_sheet_2.Rows, Index=Slider(0, range=0..100), Wrap=True)  # -> flatten(Item)
cull_index_4 = CullIndex(List=list_item_4, Indices=Slider(0, range=0..100), Wrap=True)
radians_4 = Radians(Degrees=cull_index_4)

# ---- group: Temperature
list_item_5 = ListItem(List=read_excel_sheet_2.Rows, Index=Slider(2, range=0..100), Wrap=True)  # -> flatten(Item)
cull_index_5 = CullIndex(List=list_item_5, Indices=Slider(0, range=0..100), Wrap=True)
c_script = CSharpScript(x=flatten(cull_index_5))  # -> out, A; inputs x: String
# ---------- c_script: C# ----------
    string ou = x;

    if( ou == "" ) ou = "1";

    double inte = System.Convert.ToDouble(ou);

    A = ou;
# ---------- end c_script ----------
bounds = Bounds(Numbers=c_script.A)
construct_domain = ConstructDomain(DomainStart=0, DomainEnd=Slider(255, range=0..1000))
remap_numbers = RemapNumbers(Value=c_script.A, Source=bounds, Target=construct_domain)  # -> Mapped, Clipped

# ---- group: Precipitation / PrecipitationLongitude
list_item_6 = ListItem(List=read_excel_sheet_3.Rows, Index=Slider(1, range=0..100), Wrap=True)  # -> flatten(Item)
cull_index_6 = CullIndex(List=list_item_6, Indices=Slider(0, range=0..100), Wrap=True)
radians_5 = Radians(Degrees=cull_index_6)

# ---- group: Precipitation / PrecipitationLatitude
list_item_7 = ListItem(List=read_excel_sheet_3.Rows, Index=Slider(0, range=0..100), Wrap=True)  # -> flatten(Item)
cull_index_7 = CullIndex(List=list_item_7, Indices=Slider(0, range=0..100), Wrap=True)
radians_6 = Radians(Degrees=cull_index_7)

# ---- group: Ice / IceLatitude
list_item_8 = ListItem(List=read_excel_sheet_4.Rows, Index=Slider(0, range=0..100), Wrap=True)  # -> flatten(Item)
cull_index_8 = CullIndex(List=list_item_8, Indices=Slider(0, range=0..100), Wrap=True)
radians_7 = Radians(Degrees=cull_index_8)

# ---- group: Ice / IceLongitude
list_item_9 = ListItem(List=read_excel_sheet_4.Rows, Index=Slider(1, range=0..100), Wrap=True)  # -> flatten(Item)
cull_index_9 = CullIndex(List=list_item_9, Indices=Slider(0, range=0..100), Wrap=True)
radians_8 = Radians(Degrees=cull_index_9)

# ---- group: Precipitation
list_item_10 = ListItem(List=read_excel_sheet_3.Rows, Index=Slider(2, range=0..100), Wrap=True)  # -> flatten(Item)
cull_index_10 = CullIndex(List=list_item_10, Indices=Slider(0, range=0..100), Wrap=True)
c_script_2 = CSharpScript(x=flatten(cull_index_10))  # -> out, A; inputs x: String; same code as c_script
bounds_2 = Bounds(Numbers=c_script_2.A)
construct_domain_2 = ConstructDomain(DomainStart=0, DomainEnd=Slider(255, range=0..1000))
remap_numbers_2 = RemapNumbers(Value=c_script_2.A, Source=bounds_2, Target=construct_domain_2)  # -> Mapped, Clipped

# ---- group: Ice
list_item_11 = ListItem(List=read_excel_sheet_4.Rows, Index=Slider(2, range=0..100), Wrap=True)  # -> flatten(Item)
cull_index_11 = CullIndex(List=list_item_11, Indices=Slider(0, range=0..100), Wrap=True)
c_script_3 = CSharpScript(x=flatten(cull_index_11))  # -> out, A; inputs x: String; same code as c_script
bounds_3 = Bounds(Numbers=c_script_3.A)
construct_domain_3 = ConstructDomain(DomainStart=0, DomainEnd=Slider(255, range=0..1000))
remap_numbers_3 = RemapNumbers(Value=c_script_3.A, Source=bounds_3, Target=construct_domain_3)  # -> Mapped, Clipped

# ----
number_slider = Slider(0, range=0..100)

# ---- group: Wind
list_item_12 = ListItem(List=read_excel_sheet.Rows, Index=Slider(2, range=0..100), Wrap=True)  # -> flatten(Item)
cull_index_12 = CullIndex(List=list_item_12, Indices=Slider(0, range=0..100), Wrap=True)
c_script_4 = CSharpScript(x=flatten(cull_index_12))  # -> out, A; inputs x: String; same code as c_script
number_slider_2 = Slider(255, range=0..1000)
bounds_4 = Bounds(Numbers=c_script_4.A)
construct_domain_4 = ConstructDomain(DomainStart=0, DomainEnd=Slider(0.5, range=0..1000))
bounds_5 = Bounds(Numbers=c_script_4.A)
construct_domain_5 = ConstructDomain(DomainStart=number_slider, DomainEnd=number_slider_2)
remap_numbers_4 = RemapNumbers(Value=c_script_4.A, Source=bounds_4, Target=construct_domain_4)  # -> Mapped, Clipped
remap_numbers_5 = RemapNumbers(Value=c_script_4.A, Source=bounds_5, Target=construct_domain_5)  # -> Mapped, Clipped

# ----
deconstruct_domain = DeconstructDomain(Domain=bounds_5)  # -> Start, End

# ---- group: Wind / Projections
number_slider_3 = Slider(0.001, range=0..1)

# ---- group: Wind / Projections / WebMercator
mercator = CSharpScript(lat=radians_2, lon=radians)  # -> out, A; inputs lat: Double, lon: Double
# ---------- mercator: C# ----------
    A = CassiniProjection(lat, lon);
# ---------- mercator: C# additional code ----------
  public Point3d CassiniProjection(double lat, double lon)
  {

    var earthRadius = 6367;

    double FSin = Math.Sin( lon );
    
    var x = lat * earthRadius;
    var y = ( earthRadius * 0.5 ) * Math.Log( ( 1.0 + FSin ) / ( 1.0 - FSin ) );

    return new Point3d(x, y, 0);

  }
# ---------- end mercator ----------
multiplication = Multiplication(A=mercator.A, B=number_slider_3)

# ---- group: Wind / Projections / Cassini
cassini = CSharpScript(lat=radians_2, lon=radians)  # -> out, A; inputs lat: Double, lon: Double
# ---------- cassini: C# ----------
    A = CassiniProjection(lat, lon);
# ---------- cassini: C# additional code ----------
  public Point3d CassiniProjection(double lat, double lon)
  {

    var earthRadius = 6367;

    var x = earthRadius * Math.Asin(Math.Cos(lat) * Math.Sin(lon));
    var y = earthRadius * Math.Atan2(Math.Sin(lat), Math.Cos(lat) * Math.Cos(lon));
    var z = earthRadius * Math.Sin(lat);
    return new Point3d(x, y, 0);

  }
# ---------- end cassini ----------
multiplication_2 = Multiplication(A=cassini.A, B=number_slider_3)

# ---- group: Wind / Projections / Spherical
spherical = CSharpScript(x=radians, y=radians_2)  # -> out, A; inputs x: Double, y: Double
# ---------- spherical: C# ----------
    A = convertSphericalToCartesian(x, y);
# ---------- spherical: C# additional code ----------
  public Point3d convertSphericalToCartesian(double lat, double lon)
  {

    var earthRadius = 6367;

    var x = earthRadius * Math.Cos(lat) * Math.Cos(lon);
    var y = earthRadius * Math.Cos(lat) * Math.Sin(lon);
    var z = earthRadius * Math.Sin(lat);
    return new Point3d(x, y, z);

  }
# ---------- end spherical ----------
multiplication_3 = Multiplication(A=spherical.A, B=number_slider_3)

# ---- group: Precipitation / Projections
number_slider_4 = Slider(0.001, range=0..1)

# ---- group: Precipitation / Projections / Cassini
cassini_2 = CSharpScript(lat=radians_6, lon=radians_5)  # -> out, A; inputs lat: Double, lon: Double; same code as cassini
multiplication_4 = Multiplication(A=cassini_2.A, B=number_slider_4)

# ---- group: Precipitation / Projections / Spherical
spherical_2 = CSharpScript(x=radians_5, y=radians_6)  # -> out, A; inputs x: Double, y: Double; same code as spherical
multiplication_5 = Multiplication(A=spherical_2.A, B=number_slider_4)

# ---- group: Ice / Projections
number_slider_5 = Slider(0.001, range=0..1)

# ---- group: Ice / Projections / Cassini
cassini_3 = CSharpScript(lat=radians_7, lon=radians_8)  # -> out, A; inputs lat: Double, lon: Double; same code as cassini
multiplication_6 = Multiplication(A=cassini_3.A, B=number_slider_5)

# ---- group: Ice / Projections / Spherical
spherical_3 = CSharpScript(x=radians_8, y=radians_7)  # -> out, A; inputs x: Double, y: Double; same code as spherical
multiplication_7 = Multiplication(A=spherical_3.A, B=number_slider_5)

# ---- group: Projections
number_slider_6 = Slider(0.001, range=0..1)

# ---- group: Projections / Cassini
cassini_4 = CSharpScript(lat=radians_4, lon=radians_3)  # -> out, A; inputs lat: Double, lon: Double; same code as cassini
multiplication_8 = Multiplication(A=cassini_4.A, B=number_slider_6)

# ---- group: Projections / Spherical
spherical_4 = CSharpScript(x=radians_3, y=radians_4)  # -> out, A; inputs x: Double, y: Double; same code as spherical
multiplication_9 = Multiplication(A=spherical_4.A, B=number_slider_6)

# ---- group: BoxesAndDisplacement
construct_point = ConstructPoint(XCoordinate=0, YCoordinate=0, ZCoordinate=0)  # disabled
vector_2pt = Vector2Pt(PointA=construct_point, PointB=multiplication_3, Unitize=False)  # -> Vector, Length; disabled
amplitude = Amplitude(Vector=vector_2pt.Vector, Amplitude=remap_numbers.Mapped)  # disabled
number = Number(remap_numbers_4.Mapped)  # disabled
vector_display = VectorDisplay(Anchor=construct_point, Vector=amplitude)  # disabled
move = Move(Geometry=multiplication_3, Motion=amplitude)  # -> Geometry, Transform; disabled
center_box = CenterBox(Base=move.Geometry, X=number, Y=number, Z=number)  # disabled

# ---- group: CheckIfNULL
null_item = NullItem(Item=multiplication)  # -> NullFlags, InvalidFlags, Description
dispatch = Dispatch(List=remap_numbers_4.Mapped, DispatchPattern=null_item.InvalidFlags)  # -> ListA, ListB
dispatch_2 = Dispatch(List=multiplication, DispatchPattern=null_item.InvalidFlags)  # -> ListA, ListB
number_2 = Number(dispatch.ListB)
point = Point(dispatch_2.ListB)

# ----
list_item_13 = ListItem(List=multiplication, Index=Slider(16341, range=0..100000), Wrap=True)

# ---- group: CullLowerAndUpperLongitudes
deconstruct = Deconstruct(Point=point)  # -> XComponent, YComponent, ZComponent
setlongitudeupperlowerbounds = CSharpScript(x=deconstruct.YComponent, y=Slider(17.77, range=0..100))  # -> A; inputs x: Double, y: Double
# ---------- setlongitudeupperlowerbounds: C# ----------
    bool test = false;
    double max = -y;
    if( x < y && x > max )
    {

      test = true;

    }

    A = test;
# ---------- end setlongitudeupperlowerbounds ----------
cull_pattern = CullPattern(List=point, CullPattern=setlongitudeupperlowerbounds)
cull_pattern_2 = CullPattern(List=number_2, CullPattern=setlongitudeupperlowerbounds)

# ---- group: HeightMap
unit_z = UnitZ(Factor=cull_pattern_2)
move_2 = Move(Geometry=cull_pattern, Motion=unit_z)  # -> Geometry, Transform
gradient = Gradient(
    LowerLimit=number_slider_2,
    UpperLimit=number_slider,
    Parameter=remap_numbers_5.Mapped,
    stops=[0: RGB(234, 38, 0), 0.25: RGB(234, 126, 0), 0.5: RGB(254, 244, 84), 0.75: RGB(173, 203, 249), 1: RGB(75, 107, 169)])
delaunay_mesh = DelaunayMesh(Points=move_2.Geometry, Plane=PlaneXY(0, 0, 0))
mesh_colours = MeshColours(Mesh=delaunay_mesh, Colours=gradient)
weaverbird_s_loop_subdivision = WeaverbirdsLoopSubdivision(MeshCurves=mesh_colours, Level=1, SmoothNakedEdges=1)  # disabled
weaverbird_s_midedge_subdivision = WeaverbirdsMidedgeSubdivision(MeshCurves=mesh_colours, Level=1, SmoothNakedEdges=1)  # disabled
weaverbird_s_catmull_clark_subdivision = WeaverbirdsCatmullClarkSubdivision(MeshCurves=mesh_colours, Level=1, SmoothNakedEdges=1)  # disabled

# ---- group: PointCloudViz
colour_rgb = ColourRGB(Alpha=255, Red=expr("x*10", remap_numbers.Clipped), Green=0, Blue=0)
colour_rgb_2 = ColourRGB(Alpha=255, Red=remap_numbers_5.Mapped, Green=0, Blue=remap_numbers_5.Mapped)
colour_rgb_3 = ColourRGB(Alpha=255, Red=0, Green=remap_numbers_2.Mapped, Blue=remap_numbers_2.Mapped)
colour_rgb_4 = ColourRGB(Alpha=255, Red=remap_numbers_3.Mapped, Green=remap_numbers_3.Mapped, Blue=remap_numbers_3.Mapped)
construct_point_cloud = ConstructPointCloud(Points=multiplication, Colours=gradient)
construct_point_cloud_2 = ConstructPointCloud(Points=multiplication_9, Colours=colour_rgb)
construct_point_cloud_3 = ConstructPointCloud(Points=multiplication_5, Colours=colour_rgb_3)
construct_point_cloud_4 = ConstructPointCloud(Points=multiplication_7, Colours=colour_rgb_4)
preview_point_cloud = PreviewPointCloud(PointCloud=construct_point_cloud, Weight=Slider(10, range=0..10))
preview_point_cloud_2 = PreviewPointCloud(PointCloud=construct_point_cloud_2, Weight=Slider(13, range=0..20))
preview_point_cloud_3 = PreviewPointCloud(PointCloud=construct_point_cloud_3, Weight=Slider(10, range=0..10))
preview_point_cloud_4 = PreviewPointCloud(PointCloud=construct_point_cloud_4, Weight=Slider(3, range=0..10))

# ---- group: AttractorsEmphasizeDataPeaks
construct_point_2 = ConstructPoint(XCoordinate=0, YCoordinate=0, ZCoordinate=0)
expression = Expression(x=cull_pattern_2, y=Slider(0.4, range=0..1), Expression="If( x > y, True, False )")
vector_2pt_2 = Vector2Pt(PointA=construct_point_2, PointB=multiplication_3, Unitize=False)  # -> Vector, Length
cull_pattern_3 = CullPattern(List=move_2.Geometry, CullPattern=expression)
cull_pattern_4 = CullPattern(List=cull_pattern_2, CullPattern=expression)
vector_display_2 = VectorDisplay(Anchor=construct_point_2, Vector=vector_2pt_2.Vector)
number_slider_7 = Slider(0, range=0..100)
vector_2pt_3 = Vector2Pt(PointA=move_2.Geometry, PointB=cull_pattern_3, Unitize=False)  # -> Vector, Length
number_slider_8 = Slider(10, range=0..100)
construct_domain_6 = ConstructDomain(DomainStart=number_slider_7, DomainEnd=number_slider_8)

# ----
remove_duplicate_points = RemoveDuplicatePoints(InputPoints=cull_pattern_3, Tolerance=Slider(2, range=0..10))  # -> OutputPoints, FirstPointIndexes
null_item_2 = NullItem(Item=remove_duplicate_points.OutputPoints)  # -> NullFlags, InvalidFlags, Description
dispatch_3 = Dispatch(List=cull_pattern_3, DispatchPattern=null_item_2.NullFlags)  # -> ListA, ListB
dispatch_4 = Dispatch(List=cull_pattern_4, DispatchPattern=null_item_2.NullFlags)  # -> ListA, ListB
point_2 = Point(dispatch_3.ListB)
number_3 = Number(dispatch_4.ListB)

# ---- group: AttractorsEmphasizeDataPeaks (continued)
spin_force = SpinForce(Plane=cull_pattern_3, Strength=number_3, Radius=number_3, Decay=2)
point_charge = PointCharge(Point=point_2, Charge=number_3, Decay=Slider(0.9, range=0..1))
merge_fields = MergeFields(Fields=spin_force)
evaluate_field = EvaluateField(Field=merge_fields, Point=cull_pattern)  # -> Tensor, Strength
bounds_6 = Bounds(Numbers=evaluate_field.Strength)
remap_numbers_6 = RemapNumbers(Value=evaluate_field.Strength, Source=bounds_6, Target=construct_domain_6)  # -> Mapped, Clipped
amplitude_2 = Amplitude(Vector=vector_2pt_3.Vector, Amplitude=remap_numbers_6.Mapped)
move_3 = Move(Geometry=move_2.Geometry, Motion=amplitude_2)  # -> Geometry, Transform
delaunay_mesh_2 = DelaunayMesh(Points=move_3.Geometry, Plane=PlaneXY(0, 0, 0))

# ----
gradient_2 = Gradient(
    LowerLimit=number_slider_8,
    UpperLimit=number_slider_7,
    Parameter=remap_numbers_6.Mapped,
    stops=[0: RGB(234, 38, 0), 0.25: RGB(234, 126, 0), 0.5: RGB(254, 244, 84), 0.75: RGB(173, 203, 249), 1: RGB(75, 107, 169)])

# ---- group: AttractorsEmphasizeDataPeaks (continued)
mesh_colours_2 = MeshColours(Mesh=delaunay_mesh_2, Colours=gradient_2)
